# Grasshopper definition @SerializeObject.gh (Grasshopper 1.0.7)

mesh_box = MeshBox(Base={Plane=PlaneXY(0, 0, 0), X=Domain(-10, 10), Y=Domain(-10, 10), Z=Domain(-10, 10)}, XCount=10, YCount=10, ZCount=10)
c_serialize = CSharpScript(x=mesh_box)  # -> out, A, B; inputs x: GeometryBase
# ---------- c_serialize: C# usings ----------
using Rhino.DocObjects;
using Rhino.Collections;
using GH_IO;
using GH_IO.Serialization;
# ---------- c_serialize: C# ----------
    byte[] objectData = Grasshopper.Kernel.GH_Convert.CommonObjectToByteArray(x);
    // From string to byte array
    // From byte array to string
    A = System.Convert.ToBase64String(objectData);
# ---------- end c_serialize ----------
panel = Panel(c_serialize.A)
c_desrialize = CSharpScript(x=panel)  # -> out, A; inputs x: String
# ---------- c_desrialize: C# ----------
    A = GH_Convert.ByteArrayToCommonObject<GeometryBase>(System.Convert.FromBase64String(x));
# ---------- end c_desrialize ----------
panel_2 = Panel(c_desrialize.A)
mesh = Mesh(c_desrialize.A)
